# Dynamo graph Paraboloide_Midi.dyn (Dynamo 2.17.1.4055)

zero = TimeSpan.Zero()
now = DateTime.Now()
timeOfDay = DateTime.TimeOfDay(dateTime=now)
add = TimeSpan.Add(timeSpan1=zero, timeSpan2=timeOfDay)
revit_uia = Python(IN[0]=add)  # CPython3
# ---------- revit_uia.python (20 lines) ----------
import clr
import Revit

clr.AddReference("ProtoGeometry")
clr.AddReference("RevitAPI")
clr.AddReference("RevitAPIUI")
clr.AddReference("RevitServices")
clr.AddReference("RevitNodes")

from Autodesk.DesignScript.Geometry import *
from Autodesk.Revit.DB import *
from RevitServices.Persistence import DocumentManager


dad = IN[0]

doc = DocumentManager.Instance.CurrentDBDocument
uia = DocumentManager.Instance.CurrentUIApplication

OUT = uia
# ----------------------------------------
code_block = CodeBlock { 0; }
MIDI_Ativar = Musica_2020.Musica_2020.MIDI_Ativar(n=code_block)
toca_0_ou_1 = IntegerSlider(1, range=0..1 step 1)
instrumentos_1_a_128 = IntegerSlider(11, range=0..128 step 1)
toca_paraboloide = CodeBlock(rvuia=revit_uia, tempo=add, midi=MIDI_Ativar, toca=toca_0_ou_1, inst=instrumentos_1_a_128)
# ---------- toca_paraboloide.designscript (42 lines) ----------
rvuia;
tempo;
midi;
toca;
inst;
//---------------------------------------------------------
// Converte em string o Tempo Atual e separa segs e mils
// Configurar o período compatível com a duração
//---------------------------------------------------------
m    = 3;
mili = String.Substring ( tempo+"" , 9 , 3);
s    = (String.ToNumber ( mili)%25)+m;
x    = 0..s;
y    = x;
z1   = (0..s);
z2   = (s..0);
pt = Point.ByCoordinates ( x<1> , y , 0);
i  = 0..s-1;
j  = i+1;
p1 = pt[ 0].Translate    ( 0 , 0 , z1);
p2 = pt[-1].Translate    ( 0 , 0 , z2);
pp = Line.DivideEqually  ( g1  ,  s).StartPoint;

g1 = Line.ByStartPointEndPoint ( p1    , p2);
g2 = Line.ByStartPointEndPoint ( p1[i] , p1[j]);
g3 = Line.ByStartPointEndPoint ( p2[i] , p2[j]);
g4 = Line.ByStartPointEndPoint ( pp[i] , pp[j]);

e   = [0, 2, 4, 5, 7, 9, 10, 12];
n   = List.Count(e);
//---------------------------------------------------------
// Se aumentar a dur deve aumentar o período para que possa
// completar o ciclo
//---------------------------------------------------------
alt = (Math.Abs(Math.Floor( pp.Z )) % n);
not = (s<60?60-s:s)+e[alt];
dur = Math.Floor (10000 / ((s+1) * (s+1)));
din = (Math.Abs(Math.Floor( pp.Z )) % 125)+60+s;
//---------------------------------------------------------
// Tocar --------------------------------------------------
//---------------------------------------------------------
Musica_2020.Tocar_Nota( midi, not, dur, din, 1, inst+1, toca);
# ----------------------------------------
watch = Watch(toca_paraboloide.dur)
watch_2 = Watch(toca_paraboloide.s)
